# Grasshopper definition Example.gh (Grasshopper 1.0.7)
# plug-ins: Human UI

# ----
# 按照原来HumanUI使用方式设计好界面后，disable掉下面三个，把所有控件
# 接入AddElementsToRUI，把该文件放到HumanUIBaseApp/Resources/目录,设置改成
number_slider = Slider(20, range=0..100)
slider = CreateSlider(Slider=number_slider, ShowBounds=False, ShowTicks=False, ShowTooltip=False, ShowValLabel=True, showLabel=True)
values = ValueListener(Elements=slider, SomeProperty=True)  # -> Values, Indices
sph = Sphere(Base=PlaneXY(0, 0, 0), Radius=values.Values)
preview = CustomPreview(
    Geometry=sph,
    Material={diffuse=RGB(221, 160, 221), emission=RGB(66, 48, 66), shine=0.5, specular=RGB(255, 255, 255), transparency=0})

toggle = BooleanToggle(True)  # disabled
launchwin = LaunchWindow(Show=toggle, Name="Control Window", Width=370, Height=400, ChildStatus=0, EnableHorizScroll=False)  # disabled
addelems = AddElements(Window=launchwin, Elements=flatten(slider), DoVLChecking=True)  # -> AddedElements, ElementNames; disabled

addelementstorui = AddElementsToRUI(Elements=flatten(slider), DoVLChecking=True)  # -> AddedElements, ElementNames
