# Grasshopper definition baoyeTest.gh (Grasshopper 1.0.7)
# plug-ins: Robim, RobotIcPlusBevelCutting, Human UI

number_slider = Slider(0.7, range=0.1..0.9)  # disabled
显示 = BooleanToggle(True)  # disabled

# ---- group: RCP
toggle = BooleanToggle(False)  # disabled
compguid = ComponentGuid(ComponentInstance=显示)  # disabled
panel = Panel("窗口")  # disabled
c_script = CSharpScript(pub=toggle, id=compguid, name=panel)  # inputs pub: Boolean, id: Guid, name: String; disabled
# ---------- c_script: C# usings ----------
using Grasshopper.GUI;
using Grasshopper.GUI.RemotePanel;
# ---------- c_script: C# ----------
    RcpLayout layout = this.GrasshopperDocument.RemotePanelLayout;
    int count = layout.Count;

    if (pub)
    {
      if (count == 0)
      {
        IGH_DocumentObject toggle = this.GrasshopperDocument.FindObject(id, false);
        IRcpAwareObject rcpAware = toggle as IRcpAwareObject;
        IRcpItem proxy = rcpAware.PublishRcpItem();
        Grasshopper.Instances.ShowRemotePanel();
        RcpGroup container = this.GrasshopperDocument.RemotePanelLayout.EnsureGroup();
        container.Name = name;
        container.Expand();
        container.AddItem(proxy);
        this.GrasshopperDocument.RemotePanelLayout.OnLayoutChanged();
      }
    }
    else
    {
      for (int i = count - 1; i >= 0; i--)
      {
        layout.RemoveAt(i);
      }
    }
# ---------- end c_script ----------

# ----
垫件高度_毫米 = Slider(0, range=0..200)
x轴位移_毫米 = Slider(0, range=-1000..1000)
y轴位移_毫米 = Slider(0, range=-1000..1000)
旋转角度_度 = Slider(0, range=-180..180)
panel_2 = Panel("""编号
厚度""")
模拟进度 = Slider(0, range=0..1)
模拟速率 = Slider(0.1, range=0.001..0.5)
txt = Text(panel_2)
panel_3 = Panel("""无调整
位姿1
位姿2
位姿3""")
panel_4 = Panel("""定位
切割""")
tb = CreateTextBlock(Text="无错误", TextSize=16, Justification=1)
tb_2 = CreateTextBlock(Text="无错误", TextSize=16, Justification=1)
label = CreateLabel(LabelText="等离子切割", LabelSize=12, Justification=0)
label_2 = CreateLabel(LabelText="火焰切割", LabelSize=12, Justification=0)
datatable = CreateDataTable(Data=graft(""), ColumnHeadings=txt, AllowSorting=True, ColumnSizingMode=-1)
button = CreateButton(ButtonName="应用工件更改", ButtonStyle=0)
tb_3 = CreateTextBlock(Text="无错误", TextSize=16, Justification=1)
filepicker = CreateFilePicker(ButtonLabelText="浏览...", DialogType=0, MustExist=True, Filter="dwg|*dwg*")
tb_4 = CreateTextBlock(Text=" ", TextSize=12, Justification=1)  # disabled
label_3 = CreateLabel(LabelText="扫描", LabelSize=12, Justification=0)
button_2 = CreateButton(ButtonName="刷新", ButtonStyle=0)
label_4 = CreateLabel(LabelText="坡口参数", LabelSize=18, Justification=0)  # disabled
label_5 = CreateLabel(LabelText="工件图纸", LabelSize=12, Justification=0)
filepicker_2 = CreateFilePicker(ButtonLabelText="浏览...", DialogType=1, MustExist=True, Filter="json|*json*")
button_3 = CreateButton(ButtonName="导出", ButtonStyle=0)
pulldown = CreatePulldownMenu(Label="仿真阶段", ListItems=panel_4, SelectedIndex="1", showLabel=True)
slider = CreateSlider(Slider=模拟进度, ShowBounds=False, ShowTicks=False, ShowTooltip=False, ShowValLabel=True, showLabel=True)
slider_2 = CreateSlider(Slider=模拟速率, ShowBounds=False, ShowTicks=False, ShowTooltip=False, ShowValLabel=True, showLabel=True)
button_4 = CreateButton(ButtonName="重置", ButtonStyle=0)
pulldown_2 = CreatePulldownMenu(Label="枪头位姿", ListItems=panel_3, showLabel=True)
label_6 = CreateLabel(LabelText="工件导出", LabelSize=12, Justification=0)
checkbox = CreateCheckbox(Label="合并路径", StartingValue=Toggle(True))
button_5 = CreateButton(ButtonName="应用工艺调整", ButtonStyle=0)
slider_3 = CreateSlider(Slider=旋转角度_度, ShowBounds=False, ShowTicks=False, ShowTooltip=False, ShowValLabel=True, showLabel=True)
slider_4 = CreateSlider(Slider=x轴位移_毫米, ShowBounds=False, ShowTicks=False, ShowTooltip=False, ShowValLabel=True, showLabel=True)
slider_5 = CreateSlider(Slider=y轴位移_毫米, ShowBounds=False, ShowTicks=False, ShowTooltip=False, ShowValLabel=True, showLabel=True)
slider_6 = CreateSlider(Slider=垫件高度_毫米, ShowBounds=False, ShowTicks=False, ShowTooltip=False, ShowValLabel=True, showLabel=True)
tb_5 = CreateTextBlock(Text=" ", TextSize=12, Justification=1)
toggle_2 = CreateToggle(Default=False, OnLabel="播放", OffLabel="暂停")
button_6 = CreateButton(ButtonName="应用位置更改", ButtonStyle=0)
label_7 = CreateLabel(LabelText="位置参考", LabelSize=18, Justification=0)
swatch = ColourSwatch(SwatchColor=RGB(255, 255, 255))
swatch_2 = ColourSwatch(SwatchColor=RGBA(235, 187, 110, 133))
merge = Merge(Data1=label_5, Data2=filepicker, Data3=button_2)
panel_5 = Panel("361")  # disabled
border = CreateBorder(UIElement=tb_4, BorderThickness=5, BorderColor=swatch_2, CornerRadius="5")
merge_2 = Merge(Data1=pulldown, Data2=button_4)
swatch_3 = ColourSwatch(SwatchColor=RGBA(235, 187, 110, 133))
adjustpos = AdjustElementPositioning(ElementsToAdjust=filepicker_2, AbsolutePositioning=False, Width=panel_5)  # disabled
border_2 = CreateBorder(UIElement=tb_3, BorderThickness="1", BorderColor=swatch, CornerRadius="5")
border_3 = CreateBorder(UIElement=tb_2, BorderThickness="1", BorderColor=swatch, CornerRadius="5")
border_4 = CreateBorder(UIElement=tb, BorderThickness="1", BorderColor=swatch, CornerRadius="5")
expander = CreateExpander(UIElements=merge, Header="数据导入", Open=True)
stack = CreateStack(UIElements=merge_2, Horizontal=True)
merge_3 = Merge(Data1=slider_3, Data2=slider_4, Data3=slider_5, Data4=slider_6, Data5=button_6)
merge_4 = Merge(Data1=pulldown_2, Data2=checkbox)
hideshow = HideShowElement(ElementToHideShow=pulldown_2, Show=True, Collapse=True, Disable=True)

# ---- group: Copyright
# 切割单站
# 离线编程
# ver. 2022.01.18
robotic = BooleanToggle(False)
c_script_2 = CSharpScript(Plus=robotic)  # inputs Plus: Boolean
# ---------- c_script_2: C# usings ----------
using Grasshopper.GUI;
# ---------- c_script_2: C# ----------
    if (Plus)
    {
      editor.Activated += OnActivated;
      editor.Load += OnActivated;
    }
        else
        {
          editor.Activated -= OnActivated;
          editor.Load -= OnActivated;
        }
# ---------- c_script_2: C# additional code ----------
  private GH_DocumentEditor editor = Grasshopper.Instances.DocumentEditor;

  private void OnActivated(Object sender, EventArgs e)
  {
    editor.Hide();
  }
# ---------- end c_script_2 ----------

# ----
adjustelem = AdjustElementAppearance(ElementsToAdjust=tb_5, Foreground=ColourSwatch(SwatchColor=RGB(255, 255, 255)), Background=swatch_3, FontSize="14")
adjustelem_2 = AdjustElementAppearance(ElementsToAdjust=label_7, Foreground=swatch_3, FontSize="16")
merge_5 = Merge(Data1=label_3, Data2=border_2)
toggle_3 = BooleanToggle(False)
merge_6 = Merge(Data1=label_2, Data2=border_3)
merge_7 = Merge(Data1=label, Data2=border_4)
adjustelem_3 = AdjustElementAppearance(ElementsToAdjust=label_4, Foreground=swatch_2, FontSize="16")
adjustelem_4 = AdjustElementAppearance(ElementsToAdjust=tb_4, Foreground=ColourSwatch(SwatchColor=RGB(255, 255, 255)), Background=swatch_2, FontSize="14")
stack_2 = CreateStack(UIElements=merge_4, Horizontal=True)
merge_8 = Merge(Data1=flatten(datatable), Data3=flatten(label_4), Data4=flatten(border))  # -> flatten(Result)
swatch_4 = ColourSwatch(SwatchColor=RGB(255, 0, 0))
swatch_5 = ColourSwatch(SwatchColor=RGB(255, 255, 255))
merge_9 = Merge(Data1=label_6, Data2=filepicker_2, Data3=button_3)
merge_10 = Merge(Data1=slider, Data2=slider_2, Data3=stack, Data4=toggle_2)
border_5 = CreateBorder(UIElement=tb_5, BorderThickness="1", BorderColor=swatch_3, CornerRadius="5")
swatch_6 = ColourSwatch(SwatchColor=RGB(0, 255, 0))
settextblock = SetTextBlockContents(TextBlockToModify=tb_4)
stack_3 = CreateStack(UIElements=merge_6, Horizontal=toggle_3)
stack_4 = CreateStack(UIElements=merge_5, Horizontal=toggle_3)
stack_5 = CreateStack(UIElements=merge_7, Horizontal=toggle_3)
merge_11 = Merge(Data1=stack_2, Data2=button_5)
merge_12 = Merge(Data1=merge_3, Data2=label_7, Data3=border_5)
merge_13 = Merge(Data1=stack_4, Data2=stack_3, Data3=stack_5)
expander_2 = CreateExpander(UIElements=merge_13, Header="错误检查", Open=True)
expander_3 = CreateExpander(UIElements=merge_8, Header="坡口定义", Open=True)
expander_4 = CreateExpander(UIElements=merge_11, Header="工艺调整", Open=True)
expander_5 = CreateExpander(UIElements=merge_12, Header="工件位置", Open=True)
expander_6 = CreateExpander(UIElements=merge_10, Header="仿真模拟", Open=True)
expander_7 = CreateExpander(UIElements=merge_9, Header="数据导出", Open=Toggle(True))
merge_14 = Merge(Data1=flatten(expander), Data2=flatten(expander_3))
merge_15 = Merge(Data1=flatten(expander_2), Data2=flatten(expander_4), Data4=flatten(expander_6), Data5=flatten(expander_7))
panel_6 = Panel("""工件编程
工程编程""")
panel_7 = Panel("""火焰
等离子""")
tabs = TabbedView(TabNames=panel_6, TabTextSize=20, Tab0=flatten(merge_14), Tab1=flatten(merge_15))
pulldown_3 = CreatePulldownMenu(Label="割炬类型", ListItems=panel_7, SelectedIndex="1", showLabel=True)

values = ValueListener(Elements=filepicker, SomeProperty=True)  # -> Values, Indices
values_2 = ValueListener(Elements=button_2, SomeProperty=True)  # -> Values, Indices
values_3 = ValueListener(Elements=datatable, SomeProperty=True)  # -> Values, Indices
values_4 = ValueListener(Elements=button, SomeProperty=True)  # -> Values, Indices
values_5 = ValueListener(Elements=pulldown_2, SomeProperty=True)  # -> Values, Indices
values_6 = ValueListener(Elements=checkbox, SomeProperty=True)  # -> Values, Indices
values_7 = ValueListener(Elements=button_5, SomeProperty=True)  # -> Values, Indices
values_8 = ValueListener(Elements=slider_3, SomeProperty=True)  # -> Values, Indices
values_9 = ValueListener(Elements=slider_4, SomeProperty=True)  # -> Values, Indices
values_10 = ValueListener(Elements=slider_5, SomeProperty=True)  # -> Values, Indices
values_11 = ValueListener(Elements=slider_6, SomeProperty=True)  # -> Values, Indices
values_12 = ValueListener(Elements=button_6, SomeProperty=True)  # -> Values, Indices
values_13 = ValueListener(Elements=slider_2, SomeProperty=True)  # -> Values, Indices
values_14 = ValueListener(Elements=pulldown, SomeProperty=True)  # -> Values, Indices
values_15 = ValueListener(Elements=toggle_2, SomeProperty=True)  # -> Values, Indices
values_16 = ValueListener(Elements=button_4, SomeProperty=True)  # -> Values, Indices
values_17 = ValueListener(Elements=filepicker_2, SomeProperty=True)  # -> Values, Indices
values_18 = ValueListener(Elements=button_3, SomeProperty=True)  # -> Values, Indices

applyopt_bool = Boolean(values_7.Values)
merge_16 = Merge(Data1=flatten(pulldown_3), Data2=flatten(button))
stack_6 = CreateStack(UIElements=merge_16, Horizontal=True)
yz = YZPlane(Origin=Point(0, 0, 0))
shared_window = SharedWindow()  # -> WindowObject, ViewportCtrlObject, ShadowViewportObject
crv = Curve(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)
area = Area(Geometry=crv)  # -> Area, Centroid
pflip = FlipPlane(Plane=yz, ReverseX=False, ReverseY=False, SwapAxes=True)
merge_17 = Merge(Data1=stack_6, Data3=tabs)

# ---- group: Window
panel_8 = Panel("720")  # disabled
panel_9 = Panel("切割单站-离线编程")  # disabled
panel_10 = Panel("Microsoft Yahei UI")  # disabled
multiplication = Multiplication(A=number_slider, B=panel_8)  # disabled
int = Integer(multiplication)  # disabled
launchwin = LaunchWindow(Show=显示, Name=panel_9, Width=int, Height=panel_8, FontFamily=panel_10, ChildStatus=1, EnableHorizScroll=False)  # disabled
addelems = AddElements(Window=launchwin, Elements=flatten(merge_17), DoVLChecking=True)  # -> AddedElements, ElementNames; disabled
panel_11 = Panel("Amber")  # disabled
winprops = SetWindowProperties(Window=launchwin, AccentColor=panel_11, ShowTitleBar=True, ScaleFactor=1)  # disabled

# ---- group: Var
pathr2a = PathRelativeToAbsolute(RelativePath="etc\config.json")
file = ReadFile(File=pathr2a, PerLineParse=False)
config = GhPythonScript(config=file, refresh=Button())  # -> out, tcp, scanDistance, scanAngle, scanSpeed, baseSpeed, safeLift, tolerance; inputs refresh: Boolean
# ---------- config: Python ----------
__author__ = "Roboticplus"
__version__ = "2021.11.24"

import json

configTable = json.loads(config)
tcp = configTable["tcp"]
scanDistance = configTable["scanDistance"]
scanAngle = configTable["scanAngle"]
scanSpeed = configTable["scanSpeed"] * 1000
baseSpeed = configTable["baseSpeed"]
safeLift = configTable["safeLift"]
tolerance = configTable["tolerance"]
# ---------- end config ----------
table1 = Curve(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)
Z = UnitZ(Factor="0")
scanheight = Curve(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)
tablenumber = BooleanToggle(False)
move = Move(Geometry=table1, Motion=Z)  # -> Geometry, Transform
xy = XYPlane(Origin=Point(0, 0, 0))
move_2 = Move(Geometry=scanheight, Motion=Z)  # -> Geometry, Transform
num = Number(config.tcp)
num_2 = Number(config.scanDistance)
num_3 = Number(config.safeLift)
num_4 = Number(config.tolerance)
num_5 = Number(config.scanAngle)
num_6 = Number(config.baseSpeed)
mesh = Mesh([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])

# ---- group: pos
plane = Plane(Plane(origin=(1619.346925, 10.749977, 1636.546385), x=(0.009229160459, -0.05079753325, -0.9986663273), y=(-0.006557475667, -0.9986904619, 0.05073816005)))

# ----
pl_origin = PlaneOrigin(Base=pflip, Origin=area.Centroid)
pt = Point(plane)
pl_origin_2 = PlaneOrigin(Base=pl_origin, Origin=pt)
values_19 = ValueListener(Elements=tabs, SomeProperty=True)  # -> Values, Indices

# ---- group: I
refreshtfprev_bool = Boolean(values_16.Values)
exjsonpath_string = Text(values_17.Values)
dwgfile_string = Text(values.Values)
reimport_bool = Boolean(values_2.Values)
resetsim_bool = Boolean(values_16.Values)
runsim_bool = Boolean(values_15.Values)
exjson_bool = Boolean(values_18.Values)
velocity_float = Number(values_13.Values)
applytf_bool = Boolean(Toggle(False))
tabindex_int = Integer(values_19.Indices)
wpindex_int = Integer(values_3.Indices)
replan_bool = Boolean(values_4.Values)
merge_bool = Boolean(values_6.Values)
orient_int = Number(values_5.Indices)
stage_int = Integer(values_14.Indices)
a_float = Number(values_8.Values)
x_float = Number(values_9.Values)
y_float = Number(values_10.Values)
z_float = Number(values_11.Values)

# ----
c_script_3 = CSharpScript(idx=tabindex_int)  # -> out, A; inputs idx: Int32
# ---------- c_script_3: C# ----------
    A = idx == 0;
    //Console.WriteLine(A);
# ---------- end c_script_3 ----------
deplane = DeconstructPlane(Plane=pl_origin_2)  # -> Origin, XAxis, YAxis, ZAxis
values_20 = ValueListener(Elements=pulldown_3, SomeProperty=True)  # -> Values, Indices
addelementstorui = AddElementsToRUI(Elements=flatten(merge_17), DoVLChecking=True)  # -> AddedElements, ElementNames
multiplication_2 = Multiplication(A=deplane.XAxis, B="-150")
move_3 = Move(Geometry=pl_origin_2, Motion=multiplication_2)  # -> Geometry, Transform
xy_2 = XYPlane(Origin=Point(0, 0, 0))
num_7 = Number(config.scanSpeed)
orient = Orient(Source=xy_2, Target=move_3.Geometry)  # -> Geometry, Transform
python = GhPythonScript(prm="etc\params", therm=values_20.Indices)  # -> out, file; inputs therm: Boolean
# ---------- python: Python ----------
file = prm + ("Plasma" if therm else "Flame") + ".json"
# ---------- end python ----------

# ---- group: 维利·斯图匹德
pathr2a_2 = PathRelativeToAbsolute(RelativePath=python.file)
file_2 = ReadFile(File=pathr2a_2, PerLineParse=False)
config_2 = GhPythonScript(param=file_2, refresh=Button())  # -> out, nozzleDomain, nozzleValue, kerfWidthDomain, kerfWidthValue, distanceDomain, distanceValue, timeDomain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; inputs refresh: Boolean
# ---------- config_2: Python ----------
__author__ = "Roboticplus"
__version__ = "2021.11.24"

import json

"""
import os, clr
import array
import System.Array as Array

dll = os.getenv('appdata') + "\\Grasshopper\\Libraries\\BevelCutting\\BevelCutting.gha"
clr.AddReferenceToFileAndPath(dll)

import RobotIcPlus.BevelCutting.Type.ParamTable as pt
"""

paramTable = json.loads(param)

nozzleDomain = paramTable["NozzleDomain"]
nozzleValue = paramTable["NozzleValue"]
kerfWidthDomain = paramTable["KerfWidthDomain"]
kerfWidthValue = paramTable["KerfWidthValue"]
distanceDomain = paramTable["DistanceDomain"]
distanceValue = paramTable["DistanceValue"]
timeDomain = paramTable["TimeDomain"]
timeValue = paramTable["TimeValue"]
speedDomain = paramTable["SpeedDomain"]
speedValue = paramTable["SpeedValue"]

"""
nozzleDomain = Array[float](nozzleDomain)
nozzleValue = Array[str](nozzleValue)
kerfWidthDomain = Array[float](kerfWidthDomain)
kerfWidthValue = Array[float](kerfWidthValue)
distanceDomain = Array[float](distanceDomain)
distanceValue = Array[float](distanceValue)
timeDomain = Array[float](timeDomain)
timeValue = Array[float](timeValue)
speedDomain = Array[float](speedDomain)
speedValue = Array[float](speedValue)
"""
# ---------- end config_2 ----------
num_8 = Number(config_2.nozzleDomain)
txt_2 = Text(config_2.nozzleValue)
num_9 = Number(config_2.kerfWidthDomain)
num_10 = Number(config_2.kerfWidthValue)
num_11 = Number(config_2.distanceDomain)
num_12 = Number(config_2.distanceValue)
num_13 = Number(config_2.timeDomain)
num_14 = Number(config_2.timeValue)
num_15 = Number(config_2.speedDomain)
num_16 = Number(config_2.speedValue)
importparams = ImportParams(
    NozzleDomain=num_8,
    NozzleValue=txt_2,
    KerfWidthDomain=num_9,
    KerfWidthValue=num_10,
    DistanceDomain=num_11,
    DistanceValue=num_12,
    TimeDomain=num_13,
    TimeValue=num_14,
    SpeedDomain=num_15,
    SpeedValue=num_16)

# ---- group: Robot
load_robot = LoadRobotSystem(
    RobotName="KUKA.KR20_R1810",
    hascoupledplaneeuler=False,
    hasplantformeuler=False,
    hasroboteuler=True,
    hastrackeuler=False,
    roboteulerangle="0,0,3500,0,180,0",
    trackHangUpSideDown="No")
robotsystem = RobotSystemParameter(load_robot)

# ----
list = ValueList({"DIS", "VEL"}, selected="DIS")

# ---- group: 线激光标定
pathr2a_3 = PathRelativeToAbsolute(RelativePath="etc\linePoseMatrix.xml")
c_script_4 = CSharpScript(path=pathr2a_3, refresh=Button())  # -> out, A; inputs path: String, refresh: Boolean
# ---------- c_script_4: C# usings ----------
using System.Xml;
using System.Linq;
# ---------- c_script_4: C# ----------
    XmlDocument doc = new XmlDocument();
    doc.PreserveWhitespace = true;

    doc.Load(path);
    var root = doc.SelectSingleNode("opencv_storage");
    var poseMatrix = root.SelectSingleNode("poseMatrix");
    string data = poseMatrix.SelectSingleNode("data").InnerText.Trim();

    var valList = data.Split(' ')
      .Where(s => s.Length > 0)
      .Select(s => Convert.ToDouble(s))
      .ToList();

    Transform tf = Transform.Identity;
    tf.M00 = valList[0];
    tf.M01 = valList[1];
    tf.M02 = valList[2];
    tf.M03 = valList[3];
    tf.M10 = valList[4];
    tf.M11 = valList[5];
    tf.M12 = valList[6];
    tf.M13 = valList[7];
    tf.M20 = valList[8];
    tf.M21 = valList[9];
    tf.M22 = valList[10];
    tf.M23 = valList[11];
    tf.M30 = valList[12];
    tf.M31 = valList[13];
    tf.M32 = valList[14];
    tf.M33 = valList[15];

    A = tf;
# ---------- end c_script_4 ----------
xy_3 = XYPlane(Origin=Point(0, 0, 0))
transform = Transform(Geometry=xy_3, Transform=c_script_4.A)
pln = Plane(transform)

# ----
pi = Pi(Factor="0.2")
multiplication_3 = Multiplication(A=num_6, B=1000)
list_2 = FlagFields({"Shoulder": 1, "Elbow": 2, "Wrist": 4}, selected="Elbow")

# ---- group: TCP
item = ListItem(List=num, Index=0, Wrap=True)  # -> Item, Item1, Item2, Item3, Item4, Item5, Item6, Item7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
python_2 = GhPythonScript(
    x=item.Item,
    y=item.Item1,
    z=item.Item2,
    a=item.Item3,
    b=item.Item4,
    c=item.Item5,
    rx=item.Item6,
    ry=item.Item7,
    s=item.Item8,
    f=item.Item9,
    d=item.Item10)  # -> tcpOrigin, tcpModify; inputs rx: Boolean, ry: Boolean, s: Boolean, f: Int32
# ---------- python_2: Python ----------
__author__ = "Roboticplus"
__version__ = "2021.09.15"

import math
import Rhino.Geometry as rg

plane = rg.Plane(rg.Point3d(x, y, z), rg.Plane.WorldXY.XAxis, rg.Plane.WorldXY.YAxis)
plane.Rotate(math.radians(c), rg.Plane.WorldXY.XAxis, plane.Origin)
plane.Rotate(math.radians(b), rg.Plane.WorldXY.YAxis, plane.Origin)
plane.Rotate(math.radians(a), rg.Plane.WorldXY.ZAxis, plane.Origin)

tcpOrigin = plane.Clone()

xyz = [plane.XAxis.Clone(), plane.YAxis.Clone(), plane.ZAxis.Clone()]
sgnX = -1 if rx else 1
sgnY = -1 if ry else 1
tcpModify = rg.Plane(plane.Origin, sgnX * xyz[f % 3], sgnY * xyz[(f + 1) % 3])
if s: tcpModify.Flip()

tcpModify.Translate(d * tcpModify.ZAxis)
# ---------- end python_2 ----------
pln_2 = Plane(python_2.tcpModify)

# ----
speed = CreateSpeed(Translation=multiplication_3, Rotation=pi, ExternalTranslation=1000, ExternalRotation=18.84955592)

# ---- group: flame
python_3 = GhPythonScript(flame="5", length=Slider(66, range=10..100))  # -> out, flameBrep
# ---------- python_3: Python ----------
__author__ = "roboticplus"
__version__ = "2021.08.27"

import rhinoscriptsyntax as rs
import Rhino.Geometry as rg

flameBase = rg.Circle(rg.Plane.WorldXY, flame * 0.5)
flameBody = rg.Cylinder(flameBase, length * 0.8).ToBrep(False, False)
flameTop = rg.Cone(rg.Plane.WorldXY, length * 0.2, flame * 0.5).ToBrep(False)
flameTop.Transform(rg.Transform.Mirror(rg.Plane.WorldXY))
flameTop.Translate(0, 0, length)
flameBrep = rg.Brep.JoinBreps([flameBody, flameTop], 0.01)[0]
# ---------- end python_3 ----------
brep = Brep(python_3.flameBrep)

# ----
pln_3 = Plane(python_2.tcpOrigin)
number_slider_2 = Slider(1, range=0..1)
orient_2 = Orient(Geometry=pln, Source=xy_3, Target=pln_3)  # -> Geometry, Transform

# ---- group: Tools
mesh_2 = Mesh(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)
tool_线激光 = CreateTool(Name="DefaultGHTool", TCPPlane=orient_2.Geometry, Weight="5", Mesh=mesh_2)  # -> Tool, TCPPlane
tool_火焰枪 = CreateTool(Name="DefaultGHTool", TCPPlane=pln_2, Weight="5", Mesh=mesh_2)  # -> Tool, TCPPlane

# ----
tool = ToolParameter(tool_火焰枪.Tool)
mesh_3 = Mesh()

pi_2 = Pi(Factor="0.5")
xz = XZPlane(Origin=Point(0, 0, 0))
environment = Mesh(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)
rotate = Rotate(Geometry=environment, Angle=pi_2, Plane=xz)  # -> Geometry, Transform

collisions = CheckCollisions(
    FirstSet=7,
    SecondSet="3",
    Environment=mesh_3,
    EnvironmentPlane=-1,
    LinearStepSize=Slider(10, range=0..10),
    AngularStepSize=Slider(1, range=0..1),
    Compute=Toggle(False))  # -> CollisionFound, TargetIndex, CollidedMeshes, Progress; disabled
panel_12 = Panel(collisions.CollisionFound)
ruidotconduit = RUIDotConduit(DotColor=RGB(0, 0, 0), TextColor=RGB(255, 255, 255), ForeDraw=True)
number_slider_3 = Slider(50, range=5..50)

# ---- group: WorkpieceProgramming
wpitem = WorkpieceItem(Index=wpindex_int)
importwp = ImportWorkpieces(DwgFile=dwgfile_string, Refresh=reimport_bool)
infolist = WorkpieceInformationList(workpieces=importwp)  # -> number, thickness; inputs workpieces: list
# ---------- infolist: Python ----------
ghenv.Component.Name = "WorkpieceInformationList"
ghenv.Component.NickName = "InfoList"

__author__ = "Roboticplus"
__version__ = "2021.11.08"

number, thickness= [], []

if workpieces:
    for wp in workpieces:
        try:
            number.append(wp.num)
            thickness.append(wp.thick)
        except:
            number.append("格式不正确")
            thickness.append ("格式不正确")
else:
    number.append("未导入")
    thickness.append("未导入")
# ---------- end infolist ----------
ex2json = ExportToJson(workpieces=importwp, path=exjsonpath_string, export=exjson_bool)  # inputs workpieces: list, export: Boolean
# ---------- ex2json: Python ----------
ghenv.Component.Name = "ExportToJson"
ghenv.Component.NickName = "Ex2Json"

__author__ = "Roboticplus"
__version__ = "2021.11.08"


if _export and workpieces:
    output = "{\"wp\":[" + ",".join([wp.ExportJson() for wp in workpieces]) + "]}"
    with open(path, 'w') as file:
        file.writelines(output)
# ---------- end ex2json ----------
entwine = Entwine(Branch00=infolist.number, Branch01=infolist.thickness, FlattenInputs=True)

# ----
editbevel = EditBevel(
    Workpiece=wpitem,
    ViewPort=shared_window.ShadowViewportObject,
    ViewportControl=shared_window.ViewportCtrlObject,
    Enabled=c_script_3.A)  # -> Curves, SelectedCurve, Ids, SelectedId, Lock, Brep, Properties

# ---- group: WorkpieceProgramming (continued)
filter = StreamFilter(Gate=tabindex_int, Stream0=editbevel.Curves)
editdisplay = EditDisplay(crvs=filter, selCrv=editbevel.SelectedCurve, ids=editbevel.Ids, selId=editbevel.SelectedId, id=tabindex_int)  # inputs crvs: list of Curve, selCrv: list of Curve, ids: list of Int32, selId: list of Int32, id: Int32
# ---------- editdisplay: C# usings ----------
using System.Drawing;
using System.Linq;
using Rhino.Display;
# ---------- editdisplay: C# ----------
    this.Component.Name = "EditDisplay";
    this.Component.NickName = "EditDisplay";
    c1 = selCrv.Where(c => c != null).ToList();
    c2 = crvs.Where(c => c != null).ToList();
    id1 = selId;
    id2 = ids;
    bb = BoundingBox.Empty;
    foreach(Curve cv in c1) bb.Union(cv.GetBoundingBox(false));
    foreach(Curve cv in c2) bb.Union(cv.GetBoundingBox(false));
    MyConduit d = new MyConduit(this);
    d.Enabled = id == 0;
# ---------- editdisplay: C# additional code ----------
  List<Curve> c1 = null;
  List<Curve> c2 = null;
  List<int> id1 = null;
  List<int> id2 = null;
  BoundingBox bb = BoundingBox.Empty;
  //Return a BoundingBox that contains all the geometry you are about to draw.
  public override BoundingBox ClippingBox
  {
    get
    {
      return bb;
    }
  }

  //Draw all meshes in this method.
  public override void DrawViewportMeshes(IGH_PreviewArgs args)
  {
  }

  public class MyConduit:DisplayConduit
  {
    public Script_Instance Instance;

    public MyConduit(Script_Instance s)
    {
      this.Instance = s;
    }

    protected override void DrawForeground(DrawEventArgs args)
    {
      int count = Instance.c1.Count;
      for(int i = 0;i < count;i++)
      {
        Point3d pt = Instance.c1[i].PointAtNormalizedLength(0.5);
        double t;
        Instance.c1[i].ClosestPoint(pt, out t);
        Vector3d vec = Vector3d.CrossProduct(Instance.c1[i].TangentAt(t), Vector3d.ZAxis);
        vec.Unitize();
        args.Display.DrawDot(pt + vec * 10, Instance.id1[i].ToString(), Color.Black, Color.White);
      }
      count = Instance.c2.Count;
      for(int i = 0;i < count;i++)
      {
        Point3d pt = Instance.c2[i].PointAtNormalizedLength(0.5);
        double t;
        Instance.c2[i].ClosestPoint(pt, out t);
        Vector3d vec = Vector3d.CrossProduct(Instance.c2[i].TangentAt(t), Vector3d.ZAxis);
        vec.Unitize();
        args.Display.DrawDot(pt + vec * 10, Instance.id2[i].ToString(), Color.Black, Color.White);
      }
    }
  }

  //Draw all wires and points in this method.
  public override void DrawViewportWires(IGH_PreviewArgs args)
  {
    int count = c1.Count;
    for(int i = 0;i < count;i++)
    {
      args.Display.DrawCurve(c1[i], Color.Aqua, 5);
    }
    count = c2.Count;
    for(int i = 0;i < count;i++)
    {
      args.Display.DrawCurve(c2[i], Color.Black, 3);
    }
  }
# ---------- end editdisplay ----------

# ----
selectedworkpiece = Data(wpitem)
python_4 = GhPythonScript(wp=selectedworkpiece)  # -> brep, thick
# ---------- python_4: Python ----------
thick = wp.thick
brep = wp.GetExtrusion()
# ---------- end python_4 ----------
ruicurveconduit = RUICurveConduit(Curve=filter, Color=ColourSwatch(SwatchColor=RGB(0, 0, 0)), Thickness=3, ForeDraw=False)
ruicurveconduit_2 = RUICurveConduit(Curve=editbevel.SelectedCurve, Color=ColourSwatch(SwatchColor=RGB(0, 255, 238)), Thickness=3, ForeDraw=False)
multiplication_4 = Multiplication(A=python_4.thick, B=0.5)
multiplication_5 = Multiplication(A=deplane.ZAxis, B=multiplication_4)

# ---- group: position
cluster = Cluster(content=python_4.brep, factor=python_4.thick)

# ----
python_5 = GhPythonScript(
    workpiece=selectedworkpiece,
    tableNumber=tablenumber,
    tableRegion=move.Geometry,
    wPlane=xy,
    apply=applytf_bool,
    a=a_float,
    x=x_float,
    y=y_float,
    z=z_float,
    refresh=refreshtfprev_bool)  # -> out, planeRef, transform, position; inputs tableNumber: Int32, tableRegion: Curve, wPlane: Plane, apply: Boolean, refresh: Boolean
# ---------- python_5: Python ----------
__author__ = "Roboticplus"
__version__ = "2021.08.24"

import math
import scriptcontext as sc
import Rhino.Geometry as rg
import ghpythonlib.treehelpers as th

baseBrep = workpiece.GetBaseBrep()
thickness = workpiece.thick

box = tableRegion.GetBoundingBox(True)
planeRef = rg.Plane(rg.Point3d(box.Max.X, box.Min.Y, box.Min.Z), wPlane.XAxis, wPlane.YAxis)

center = baseBrep.GetBoundingBox(True).Center

target = tableRegion.GetBoundingBox(True).Center
rotation = rg.Transform.Rotation(math.radians(a), rg.Plane.WorldXY.ZAxis, center)
flip = rg.Transform.Identity
translation = rg.Transform.Translation(target - center + rg.Vector3d(x, y, thickness * 0.5 + z))
transform = translation * rotation * flip
posX = abs(target.X + x - planeRef.OriginX)
posY = abs(target.Y + y - planeRef.OriginY)
position = "工件旋转: {0}°\n中心纵轴刻度: {1:.1f}mm\n中心横轴刻度: {2:.1f}mm\n垫件高度: {3}mm".format(a, posX, posY, z)
if apply:
    workpiece.ApplyTransform(transform, z, a)
# ---------- end python_5 ----------
move_4 = Move(Motion=multiplication_5)  # -> Geometry, Transform
merge_18 = Merge(Data1=flatten(orient.Transform), Data2=flatten(move_4.Transform))  # -> flatten(Result)
planeref = Plane(python_5.planeRef)
comp = Compound(Transforms=cluster)
pathplanning_scan = PathPlanningScan(
    workpiece=selectedworkpiece,
    tableNumber=tablenumber,
    scanHeight=move_2.Geometry,
    planeRef=planeref,
    transform=comp,
    distance=num_2,
    angle=num_5,
    refresh=replan_bool)  # -> out, pl, mt, cmd, ok; inputs scanHeight: Curve, planeRef: Plane, transform: Transform, refresh: Boolean
# ---------- pathplanning_scan: Python ----------
ghenv.Component.Name = "PathPlanning(Scan)"
ghenv.Component.NickName = "PathPlanning(Scan)"

__author__ = "Roboticplus"
__version__ = "2021.11.08"

import math
import Rhino.Geometry as rg


wx = rg.Plane.WorldXY.XAxis
wy = rg.Plane.WorldXY.YAxis


if tableNumber == 0:
    e1 = -wx
    e2 = wy
else:
    e1 = wx
    e2 = -wy

delta = [-e2 * 0, -e1 * 1, e2 * 2, e1 * 1]
d = []

e1.Unitize()
e2.Unitize()

def OrientPlane(plane, vec):
    z = plane.ZAxis
    k = -z * vec
    new_x = vec + k * z
    new_x.Unitize()
    
    if new_x * vec < 0:
        new_x = -new_x
    
    new_y = rg.Vector3d.CrossProduct(z, new_x)
    return rg.Plane(plane.Origin, new_x, new_y)

def AdjustOrientation(plane):
    a = abs(plane.XAxis * e1)
    b = abs(plane.XAxis * e2)
    newPlane = OrientPlane(plane, -e1 if a >= b else e2)
    if a < b:
        if newPlane.XAxis.Z < 0:
            dd = delta[0]
        else:
            dd = delta[2]
    else:
        if newPlane.XAxis.Z < 0:
            dd = delta[3]
        else:
            dd = delta[1]
    return newPlane, dd

def Flip(plane):
    p = rg.Plane(plane)
    p.Flip()
    return p

ok, basePlane, baseIndex, targetsBase, targetsType, planes, types, scanIndex = workpiece.GetScanTargets(angle, 80)

for i in range(len(targetsBase)):
    pp = targetsBase[i]
    pp.Transform(transform)
    targetsBase[i] = pp
targets = []
for p in targetsBase:
    ppp, ddd = AdjustOrientation(p)
    targets.append(ppp)
    d.append(ddd)

pl = []
for p in targets:
    p.Translate(-p.ZAxis * distance)
    pl.append(p)

first = rg.Plane(scanHeight.PointAtStart, rg.Plane.WorldXY.YAxis, rg.Plane.WorldXY.XAxis)
if tableNumber == 1:
    first.Rotate(math.pi, rg.Plane.WorldXY.ZAxis, rg.Plane.WorldXY.Origin)

second = first.Clone()
second.Translate(rg.Vector3d(0, 0, -600))

pl = [first, second] + pl + [second]
tp = targetsType
mt = ["Joint", "Joint"] + ["Linear"] * len(targets) + ["Joint"]
cmd = ["$OV_PRO = 50", "$OV_PRO = 100"] + ["WAIT SEC 1\n$OUT[21] = TRUE\nWAIT FOR $IN[22] == TRUE\n$OUT[21] = FALSE\nWAIT SEC 1"] * len(targets) + [""]
# ---------- end pathplanning_scan ----------
pathplanning_cut = PathPlanningCut(
    therm=Toggle(False),
    workpiece=selectedworkpiece,
    planeRef=planeref,
    transform=comp,
    baseSpeed=num_6,
    safeLift=num_3,
    tolerance=num_4,
    mergeAll=merge_bool,
    orientTarget=orient_int,
    apply=applyopt_bool,
    refresh=replan_bool,
    paramRefresh=importparams)  # -> out, pl, sw, tp, sp, cmd, zn; inputs therm: Boolean, planeRef: Plane, transform: Transform, mergeAll: Boolean, orientTarget: Int32, apply: Boolean, refresh: Boolean, paramRefresh: Boolean
# ---------- pathplanning_cut: Python ----------
ghenv.Component.Name = "PathPlanning(Cut)"
ghenv.Component.NickName = "PathPlanning(Cut)"

__author__ = "Roboticplus"
__version__ = "2021.11.08"

import Rhino.Geometry as rg

if apply:
    workpiece.ApplyOption(mergeAll, orientTarget)

workpiece.tf = transform

tf = transform.Clone()
aTf = tf.TryGetInverse()[1]
planeRef.Transform(aTf)

if therm:
    planes, sw, sp, cmd, tp, zn = workpiece.GenerateCuttingPath(planeRef, baseSpeed, safeLift, tolerance, therm, mergeAll)
else:
    planes, sw, sp, cmd, tp, zn = workpiece.GenerateCuttingPath(planeRef, baseSpeed, safeLift, tolerance, therm, mergeAll)
    zn = 1

pl = []
for p in planes:
    p.Transform(transform)
    pl.append(p)
# ---------- end pathplanning_cut ----------
pathplanning_cut_2 = PathPlanningCut(
    therm=Toggle(True),
    workpiece=selectedworkpiece,
    planeRef=planeref,
    transform=comp,
    baseSpeed=num_6,
    safeLift=num_3,
    tolerance=num_4,
    mergeAll=merge_bool,
    orientTarget=orient_int,
    apply=applyopt_bool,
    refresh=replan_bool,
    paramRefresh=importparams)  # -> out, pl, sw, tp, sp, cmd, zn; inputs therm: Boolean, planeRef: Plane, transform: Transform, mergeAll: Boolean, orientTarget: Int32, apply: Boolean, refresh: Boolean, paramRefresh: Boolean
# ---------- pathplanning_cut_2: Python ----------
ghenv.Component.Name = "PathPlanning(Cut)"
ghenv.Component.NickName = "PathPlanning(Cut)"

__author__ = "Roboticplus"
__version__ = "2021.11.08"

import Rhino.Geometry as rg

zone_control = True and therm

if apply:
    workpiece.ApplyOption(mergeAll, orientTarget)

tf = transform.Clone()
aTf = tf.TryGetInverse()[1]
planeRef.Transform(aTf)

if zone_control:
    planes, sw, sp, cmd, tp, zn = workpiece.GenerateCuttingPath(planeRef, baseSpeed, safeLift, tolerance, therm, mergeAll, 0, 0)
else:
    planes, sw, sp, cmd, tp, zn = workpiece.GenerateCuttingPath(planeRef, baseSpeed, safeLift, tolerance, therm, mergeAll, 0, 0)
    zn = 1

pl = []
for p in planes:
    p.Transform(transform)
    pl.append(p)
# ---------- end pathplanning_cut_2 ----------
num_17 = Number(pathplanning_cut.sp)
txt_3 = Text(pathplanning_cut.cmd)
pln_4 = Plane(pathplanning_scan.pl)
txt_4 = Text(pathplanning_scan.cmd)
bool = Boolean(pathplanning_scan.ok)
pln_5 = Plane(pathplanning_cut.pl)
txt_5 = Text(pathplanning_scan.mt)
txt_6 = Text(pathplanning_cut.tp)
int_2 = Integer(pathplanning_cut.zn)
int_3 = Integer(pathplanning_cut.sw)
txt_7 = Text(pathplanning_cut_2.cmd)
num_18 = Number(pathplanning_cut_2.sp)
pln_6 = Plane(pathplanning_cut_2.pl)
int_4 = Integer(pathplanning_cut_2.zn)
int_5 = Integer(pathplanning_cut_2.sw)
txt_8 = Text(pathplanning_cut_2.tp)
pline = PolyLine(Vertices=pln_4, Closed=False)
pline_2 = PolyLine(Vertices=pln_5, Closed=False)
pline_3 = PolyLine(Vertices=pln_6, Closed=False)
python_6 = GhPythonScript(sw=int_3)  # -> out, sw; inputs sw: list of Int32
# ---------- python_6: Python ----------
for i in range(len(sw)):
    sw[i] = sw[i] + (i >> 1)
# ---------- end python_6 ----------
len = Length(Curve=pline)
len_2 = Length(Curve=pline_2)
python_7 = GhPythonScript(sw=int_5)  # -> out, sw; inputs sw: list of Int32; same code as python_6
len_3 = Length(Curve=pline_3)
pln_7 = Plane(pln_6)
txt_9 = Text(txt_8)
num_19 = Number(num_18)
txt_10 = Text(txt_7)
int_6 = Integer(python_7.sw)
python_8 = GhPythonScript(tp=txt_9)  # -> out, se; inputs tp: list
# ---------- python_8: Python ----------
se = []
for i in range(len(tp)):
    if tp[i] == "Joint":
        se.append(i)
# ---------- end python_8 ----------
zone = CreateZone(Type=list, Value=int_4)
speed_2 = CreateSpeed(Translation=num_19, Rotation=pi, ExternalTranslation=1000, ExternalRotation=18.84955592)
customcmd = CustomCommand(Name="wait", Manufacturer="All", Code=txt_10)
target = CreateTarget(Plane=pln_7, RobConf=list_2, Motion=txt_9, Tool=tool, Speed=speed_2, Zone=zone, Command=customcmd, IsCartesian=True)
python_9 = GhPythonScript(se=python_8.se, tgt=target)  # -> out, tst; inputs se: list of Int32, tgt: list
# ---------- python_9: Python ----------
tst = []
for i in range(1, len(se), 2):
    tst.append(tgt[se[i]])
# ---------- end python_9 ----------
K = Kinematics(RobotSystem=robotsystem, Target=graft(python_9.tst), DisplayGeometry=False)  # -> Meshes, Joints, Planes, Errors
python_10 = GhPythonScript(jt=K.Joints)  # -> out, flatten(tst)
# ---------- python_10: Python ----------
if jt:
    jtVal = jt.split(',')
    #jtVal[2] = str(float(jtVal[2]) + 0.2)
    if abs(float(jtVal[5])) > 1.2:
        jtVal[3] = '0'
        #jtVal[4] = '-1.57'
        jtVal[5] = '0' 
    tst = ",".join(jtVal)
# ---------- end python_10 ----------
target_2 = CreateTarget(Joints=python_10.tst, Tool=tool, Speed=speed, IsCartesian=False)  # -> flatten(Target)
program = CreateProgram(Name="T", RobotSystem=robotsystem, Targets1=target, StepSize=10, UseIkfast=False, Compute=Toggle(True))  # -> Program, Code, Duration, Warnings, Errors, Progress
python_11 = GhPythonScript(se=python_8.se, tgt=target, tst=target_2)  # -> out, tgt; inputs se: list of Int32, tgt: list, tst: list
# ---------- python_11: Python ----------
__author__ = "roboticplus"
__version__ = "2021.12.22"

import rhinoscriptsyntax as rs

#for i in range(1, len(se), 2):
#    tgt[se[i]] = tst[(i >> 1)]

tgt.append(tst[(len(se) - 1) >> 1])

for i in range(len(se) - 2, 1, -2):
    tgt.insert(se[i], tst[(i >> 1)])
# ---------- end python_11 ----------

# ---- group: O
position_string = Text(python_5.position)
scanable_bool = Boolean(bool)
error_flame_string = Text()
wpinfolist_string = Text(entwine)
error_scan_string = Text()
grooveprop_string = Text(editbevel.Properties)
error_plasma_string = Text(program.Errors)

# ----
entwine_2 = Entwine(Branch00=error_scan_string, Branch01=error_flame_string, Branch02=error_plasma_string, FlattenInputs=True)
python_12 = GhPythonScript(error=entwine_2)  # -> text, ifError
# ---------- python_12: Python ----------
import re

dict = {
    "Axis": "轴",
    "outside": "超出",
    "permitted": "允许",
    "range": "范围",
    "Target": "目标",
    "out": "超出",
    "reach": "可达范围。",
    "Near": "接近",
    "wrist": "腕关节",
    "singularity": "奇异点",
    ".": "。",
    ",": "，"
}

if error:
    ifError = True
    error = re.sub(r'(\.|,)', ' \\1 ', error)
    translate = []
    for item in error.split(" "):
        if item in dict.keys():
            translate.append(dict[item])
        elif re.match(r'\d+', item):
            translate.append(item)
    text = "".join(translate)
else:
    ifError = False
    text = ""
# ---------- end python_12 ----------
setdatatable = SetDataTable(DataTableToSet=datatable, Data=wpinfolist_string, ColumnHeadings=txt)
bang = ExplodeTree(Data=python_12.text)  # -> Branch0, Branch1, Branch2
python_13 = GhPythonScript(x=python_12.ifError)  # -> a; inputs x: list
# ---------- python_13: Python ----------
__author__ = "tonyvm"
__version__ = "2021.08.29"

import rhinoscriptsyntax as rs

a = True
for item in x:
    a = a and item
# ---------- end python_13 ----------
settextblock_2 = SetTextBlockContents(TextBlockToModify=tb_5, NewTextBlockContents=position_string)
bang_2 = ExplodeTree(Data=python_13)  # -> Branch0, Branch1, Branch2
python_14 = GhPythonScript(scanable=scanable_bool, text=bang.Branch0, ifError=bang_2.Branch0)  # -> out, text, ifError; inputs scanable: Boolean, ifError: Boolean
# ---------- python_14: Python ----------
if not scanable:
    text = "未开坡口或不支持此工件形状，请阅读使用说明。"
    ifError = True
# ---------- end python_14 ----------
filter_2 = StreamFilter(Gate=python_14.ifError, Stream0=swatch_6, Stream1=swatch_4)
filter_3 = StreamFilter(Gate=bang_2.Branch1, Stream0=swatch_6, Stream1=swatch_4)
filter_4 = StreamFilter(Gate=bang_2.Branch2, Stream0=swatch_6, Stream1=swatch_4)
settextblock_3 = SetTextBlockContents(TextBlockToModify=tb_3, NewTextBlockContents=python_14.text)
adjustelem_5 = AdjustElementAppearance(ElementsToAdjust=tb_3, Foreground=swatch_5, Background=filter_2)
adjustelem_6 = AdjustElementAppearance(ElementsToAdjust=tb, Foreground=swatch_5, Background=filter_4)
adjustelem_7 = AdjustElementAppearance(ElementsToAdjust=tb_2, Foreground=swatch_5, Background=filter_3)
settextblock_4 = SetTextBlockContents(TextBlockToModify=tb, NewTextBlockContents=bang.Branch2)
settextblock_5 = SetTextBlockContents(TextBlockToModify=tb_2, NewTextBlockContents=bang.Branch1)

len_scan = Number(len)
len_cut = Number(len_2)

# ---- group: switcher & timer
filter_5 = StreamFilter(Gate=stage_int, Stream0=len_scan, Stream1=len_cut)
multiplication_6 = Multiplication(A=velocity_float, B="10")
division = Division(A=filter_5, B=multiplication_6)

# ----
total_time = Number(division)
total_length = Number(filter_5)

ghpython_script = GhPythonScript(toggle=runsim_bool, reset=resetsim_bool, limit=total_time, wnd=shared_window.WindowObject)  # -> A; inputs toggle: Boolean, reset: Boolean
# ---------- ghpython_script: Python ----------
__author__ = "Roboticplus"
__version__ = "2021.10.25"

import rhinoscriptsyntax as rs
import scriptcontext as sc


if not sc.sticky.has_key("val"):
    sc.sticky["val"] = 0
    ghenv.Component.ExpireSolution(True)
    wnd.expireToken = True
else:
    step = 1/limit
    if reset:
        sc.sticky["val"] = 0
        A = sc.sticky["val"]
    elif sc.sticky["val"] < 1:
        if toggle:
            sc.sticky["val"] += step
            A = sc.sticky["val"]
            ghenv.Component.ExpireSolution(True)
            wnd.expireToken = True
            wnd.expireInterval = 10
        else:
            A = sc.sticky["val"]
    else:
        A = 1
# ---------- end ghpython_script ----------
setslider = SetSlider(UISlider=slider, Value=ghpython_script)
sim = ProgramSimulation(Program=program.Program, Time=ghpython_script, Normalized=True)  # -> SystemMeshes, JointRotations, Plane, Index, Time, Program, Errors, TargetPlane, WorkpieceMesh, CoupledPlane
python_15 = GhPythonScript(index=sim.Index, switch=int_5)  # -> out, s; inputs index: Int32, switch: list of Int32
# ---------- python_15: Python ----------
__author__ = "roboticplus"
__version__ = "2021.08.27"

import rhinoscriptsyntax as rs

pos = -1
switch = [-10] + switch + [100000]
for i in range(len(switch) - 1):
    if index > switch[i] and index <= switch[i + 1]:
        pos = i
        break

s = pos % 2
# ---------- end python_15 ----------
item_2 = ListItem(List=sim.Plane, Index=-1, Wrap=True)

# ---- group: switcher & timer (continued)
c_script_5 = CSharpScript(interval="50", limit=total_time, run=runsim_bool, reset=resetsim_bool)  # -> A; inputs interval: Int32, limit: Double, run: Boolean, reset: Boolean; disabled
# ---------- c_script_5: C# ----------
    //limit = limit * 1000 / interval
    step = interval / (limit * 1000);


    if (timer == null)
    {
      timer = new System.Windows.Forms.Timer();
      timer.Interval = interval;
      timer.Tick += UpdateSolution;
    }

    if (reset)
    {
      progress = 0.0;
      timer.Interval = interval;
    }

    if (run && !timer.Enabled)
    {
      timer.Start();
    }
    else if (!run || timer.Enabled && progress >= 1.0)
    {
      timer.Stop();
    }

    A = progress;
# ---------- c_script_5: C# additional code ----------
  public System.Windows.Forms.Timer timer;
  public double progress;
  public double step;

  public void UpdateSolution(object source, EventArgs e)
  {
    progress += step;
    Component.ExpireSolution(true);
  }
# ---------- end c_script_5 ----------
multiplication_7 = Multiplication(A=total_length, B=c_script_5)  # disabled

# ---- group: O (continued)
progress_float = Number(c_script_5)

# ----
progress = Number(multiplication_7)

# ---- group: switcher & timer (continued)
division_2 = Division(A=progress, B=filter_5)
min = Minimum(A=division_2, B="1.0")

# ----
time = Number(min)

# ---- group: scan
tool_2 = ToolParameter(tool_线激光.Tool)
txt_11 = Text(txt_4)
pln_8 = Plane(pln_4)
txt_12 = Text(txt_5)
list_3 = ValueList({"DIS", "VEL"}, selected="VEL")
zone_2 = CreateZone(Type=list_3, Value=100)
pi_3 = Pi(Factor="0.5")
speed_3 = CreateSpeed(Translation=num_7, Rotation=pi_3, ExternalTranslation=1000, ExternalRotation=18.84955592)
customcmd_2 = CustomCommand(Name="capt", Manufacturer="All", Code=txt_11)
target_3 = CreateTarget(Plane=pln_8, Motion=txt_12, Tool=tool_2, Speed=speed_3, Command=customcmd_2, IsCartesian=True)
toggle_4 = BooleanToggle(True)

# ---- group: cut
pln_9 = Plane(pln_5)
txt_13 = Text(txt_6)
tool_3 = ToolParameter(tool_火焰枪.Tool)
txt_14 = Text(txt_3)
num_20 = Number(num_17)
int_7 = Integer(python_6.sw)
list_4 = ValueList({"DIS", "VEL"}, selected="DIS")
python_16 = GhPythonScript(tp=txt_13)  # -> out, se; inputs tp: list; same code as python_8
zone_3 = CreateZone(Type=list_4, Value=int_2)
pi_4 = Pi(Factor="0.2")
multiplication_8 = Multiplication(A=num_6, B=1000)
list_5 = FlagFields({"Shoulder": 1, "Elbow": 2, "Wrist": 4}, selected="Elbow")
speed_4 = CreateSpeed(Translation=num_20, Rotation=pi_4, ExternalTranslation=1000, ExternalRotation=18.84955592)
customcmd_3 = CustomCommand(Name="wait", Manufacturer="All", Code=txt_14)
speed_5 = CreateSpeed(Translation=multiplication_8, Rotation=pi_4, ExternalTranslation=1000, ExternalRotation=18.84955592)
target_4 = CreateTarget(
    Plane=pln_9,
    RobConf=list_5,
    Motion=txt_13,
    Tool=tool_3,
    Speed=speed_4,
    Zone=zone_3,
    Command=customcmd_3,
    IsCartesian=True)
python_17 = GhPythonScript(se=python_16.se, tgt=target_4)  # -> out, tst; inputs se: list of Int32, tgt: list; same code as python_9
K_2 = Kinematics(RobotSystem=robotsystem, Target=graft(python_17.tst), DisplayGeometry=False)  # -> Meshes, Joints, Planes, Errors
python_18 = GhPythonScript(jt=K_2.Joints)  # -> out, flatten(tst); same code as python_10
toggle_5 = BooleanToggle(True)
panel_13 = Panel("T")
target_5 = CreateTarget(Joints=python_18.tst, Tool=tool_3, Speed=speed_5, IsCartesian=False)  # -> flatten(Target)
python_19 = GhPythonScript(se=python_16.se, tgt=target_4, tst=target_5)  # -> out, tgt; inputs se: list of Int32, tgt: list, tst: list; same code as python_11

# ----
create_program = CreateProgram(
    Name=panel_13,
    RobotSystem=robotsystem,
    Targets1=target_4,
    StepSize=10,
    UseIkfast=False,
    OneFileCode=False,
    Compute=toggle_5)  # -> Program, Code, Duration, Warnings, Errors, Progress
create_program_2 = CreateProgram(
    Name=panel_13,
    RobotSystem=robotsystem,
    Targets1=target_3,
    StepSize=10,
    UseIkfast=False,
    OneFileCode=False,
    Compute=toggle_4)  # -> Program, Code, Duration, Warnings, Errors, Progress

# ---- group: cut (continued)
sim_2 = ProgramSimulation(Program=create_program.Program, Time=ghpython_script, Normalized=True)  # -> SystemMeshes, JointRotations, Plane, Index, Time, Program, Errors, TargetPlane, WorkpieceMesh, CoupledPlane
python_20 = GhPythonScript(index=sim_2.Index, switch=int_3)  # -> out, s; inputs index: Int32, switch: list of Int32; same code as python_15
item_3 = ListItem(List=sim_2.Plane, Index=-1, Wrap=True)

# ---- group: scan (continued)
sim_3 = ProgramSimulation(Program=create_program_2.Program, Time=time, Normalized=True)  # -> SystemMeshes, JointRotations, Plane, Index, Time, Program, Errors, TargetPlane, WorkpieceMesh, CoupledPlane

# ----
bool_2 = Boolean(values_20.Indices)
filter_6 = StreamFilter(Gate=bool_2, Stream0=sim_2.SystemMeshes, Stream1=sim.SystemMeshes)
filter_7 = StreamFilter(Gate=bool_2, Stream0=python_20.s, Stream1=python_15.s)
filter_8 = StreamFilter(Gate=bool_2, Stream0=pln_5, Stream1=pln_6)
filter_9 = StreamFilter(Gate=bool_2, Stream1=program.Program)
filter_10 = StreamFilter(Gate=bool_2, Stream0=item_3, Stream1=item_2)

bool_3 = Boolean(filter_7)
bool_4 = Boolean(stage_int)
bool_5 = Boolean(tabindex_int)

# ---- group: display
transform_2 = Transform(Geometry=editbevel.Brep, Transform=comp)
xy_4 = XYPlane(Origin=Point(0, 0, 0))
pln_10 = Plane(filter_10)
filter_11 = StreamFilter(Gate=tabindex_int, Stream0=editbevel.Brep, Stream1=transform_2)
and = GateAnd(C=bool_5, A=bool_4, B=bool_3)
mesh_4 = Mesh(sim_3.SystemMeshes)
mesh_5 = Mesh(filter_6)
orient_3 = Orient(Geometry=brep, Source=xy_4, Target=pln_10)  # -> Geometry, Transform
swatch_7 = ColourSwatch(SwatchColor=RGBA(133, 133, 133, 141))
filter_12 = StreamFilter(Gate=tabindex_int, Stream1=rotate.Geometry)
brep_2 = Brep([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])
brep_3 = Brep(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)
swatch_8 = ColourSwatch(SwatchColor=RGB(207, 207, 207))
filter_13 = StreamFilter(Gate=bool_4, Stream0=mesh_4, Stream1=mesh_5)
box = Box({Plane=PlaneXY(-814.5793016, -75.57888384, -512.895959), X=Domain(0, 1627.164075), Y=Domain(0, 2219.656011), Z=Domain(0, 1852.904087)})
swatch_9 = ColourSwatch(SwatchColor=RGBA(253, 255, 112, 185))
filter_14 = StreamFilter(Gate=and)
filter_15 = StreamFilter(Gate=tabindex_int, Stream1=brep_2)
filter_16 = StreamFilter(Gate=tabindex_int, Stream1=brep_3)
preview = CustomPreview(Geometry=filter_12, Material=swatch_7)  # disabled
preview_2 = CustomPreview(Geometry=filter_11, Material=swatch_8)  # disabled
zoom = GhPythonScript(
    tab=tabindex_int,
    tab0=editbevel.Brep,
    tab1=box,
    vp=shared_window.ViewportCtrlObject,
    sv=shared_window.ShadowViewportObject)  # inputs tab: Int32, tab0: Brep, tab1: Brep
# ---------- zoom: Python ----------
__author__ = "Roboticplus"
__version__ = "2021.11.23"

import Rhino as rc

zoomObj = tab0 if tab == 0 else tab1
zoomBox = zoomObj.GetBoundingBox(False)
vp.Viewport.SetCameraTarget(zoomBox.Center, True)
vp.Viewport.ZoomBoundingBox(zoomBox)
sv.SetCameraTarget(zoomBox.Center, True)
sv.ZoomBoundingBox(zoomBox)
#vp = rc.RhinoDoc.ActiveDoc.Views.ActiveView.ActiveViewport
#vp.ZoomBoundingBox(zoomBox)
# ---------- end zoom ----------
filter_17 = StreamFilter(Gate=bool_5, Stream1=filter_13)
preview_3 = CustomPreview(Geometry=filter_14, Material=swatch_9)  # disabled
mesh_6 = Mesh(filter_17)
python_21 = GhPythonScript(mesh=mesh_6)  # -> base, arm, tool; inputs mesh: list of Mesh
# ---------- python_21: Python ----------
__author__ = "Roboticplus"
__version__ = "2021.11.18"


base = mesh[0]
arm = mesh[1:-1]
tool = mesh[-1]
# ---------- end python_21 ----------
ruimeshconduit = RUIMeshConduit(Mesh=filter_11, Material=swatch_8)
ruimeshconduit_2 = RUIMeshConduit(Mesh=filter_12, Material=swatch_7)  # disabled
ruimeshconduit_3 = RUIMeshConduit(Mesh=filter_15, Material=ColourSwatch(SwatchColor=RGBA(28, 28, 28, 141)))  # disabled
swatch_10 = ColourSwatch(SwatchColor=RGB(54, 54, 54))
swatch_11 = ColourSwatch(SwatchColor=RGB(255, 129, 38))
swatch_12 = ColourSwatch(SwatchColor=RGB(161, 161, 161))
ruimeshconduit_4 = RUIMeshConduit(Mesh=filter_16, Material=ColourSwatch(SwatchColor=RGBA(255, 0, 0, 141)))  # disabled
preview_4 = CustomPreview(Geometry=python_21.base, Material=swatch_10)  # disabled
preview_5 = CustomPreview(Geometry=python_21.arm, Material=swatch_11)  # disabled
preview_6 = CustomPreview(Geometry=python_21.tool, Material=swatch_12)  # disabled

# ----
saveprog = SaveProgram(Program=filter_9, Folder="\\172.31.1.147\TR_1", Save=Button())
ruimeshconduit_5 = RUIMeshConduit(Mesh=filter_14, Material=swatch_9)
ruimeshconduit_6 = RUIMeshConduit(Mesh=python_21.arm, Material=swatch_11)
ruimeshconduit_7 = RUIMeshConduit(Mesh=python_21.tool, Material=swatch_12)
ruimeshconduit_8 = RUIMeshConduit(Mesh=python_21.base, Material=swatch_10)
deplane_2 = DeconstructPlane(Plane=filter_8)  # -> Origin, XAxis, YAxis, ZAxis
deplane_3 = DeconstructPlane(Plane=filter_10)  # -> Origin, XAxis, YAxis, ZAxis
multiplication_9 = Multiplication(A=deplane_2.ZAxis, B=number_slider_3)
multiplication_10 = Multiplication(A=deplane_3.ZAxis, B=number_slider_3)
move_5 = Move(Geometry=deplane_2.Origin, Motion=multiplication_9)  # -> Geometry, Transform
move_6 = Move(Geometry=deplane_3.Origin, Motion=multiplication_10)  # -> Geometry, Transform
ln = Line(StartPoint=deplane_2.Origin, EndPoint=move_5.Geometry)
ln_2 = Line(StartPoint=deplane_3.Origin, EndPoint=move_6.Geometry)
preview_7 = CustomPreview(Geometry=ln, Material=ColourSwatch(SwatchColor=RGB(0, 255, 47)))
python_22 = GhPythonScript(x=ln)  # -> x; inputs x: list
# ---------- python_22: Python ----------
x = x[1:-2]
# ---------- end python_22 ----------
loft = Loft(Curves=python_22, Options={Adjust=False, Closed=False, LoftEnds=0, LoftSimp=0, LoftType=0, Rebuild=10, Refit=0.01})

# ==== cluster Cluster
content = ClusterInput()
bounding_box = BoundingBox(Content=content, Plane=PlaneXY(0, 0, 0))  # -> Box, Box_2
box_corners = BoxCorners(Box=bounding_box.Box)  # -> CornerA, CornerB, CornerC, CornerD, CornerE, CornerF, CornerG, CornerH
polyline = PolyLine(Vertices=[box_corners.CornerA, box_corners.CornerB, box_corners.CornerC, box_corners.CornerD], Closed=True)
rectangle = Rectangle({Plane=Plane(origin=(-494.9747468, -494.9747468, 635), x=(0.7071067812, -0.7071067812, 0), y=(-0.7071067812, -0.7071067812, 0)), Size=Domain2(u=-350..350, v=-350..350)})
explode = Explode(Curve=polyline, Recursive=True)  # -> Segments, Vertices
polygon_center = PolygonCenter(Polyline=rectangle)  # -> CenterV, CenterE, CenterA
sort_list = SortList(Keys=explode.Segments, ValuesValuesA=explode.Segments)  # -> Keys, reverse(ValuesValuesA)
list_item = ListItem(List=sort_list.ValuesValuesA, Index=0, Wrap=True)
line = Line(Line((-494.9747468, 0, 0), (0, -494.9747468, 0)))
flip_curve = FlipCurve(Curve=list_item, Guide=line)  # -> Curve, Flag
end_points = EndPoints(Curve=flip_curve.Curve)  # -> Start, End
line_sdl = LineSDL(Start=end_points.Start, Direction=line, Length=1)
curve_side = CurveSide(Curve=line_sdl, Point=end_points.End)  # -> Side, Left, Right
angle = Angle(VectorA=flip_curve.Curve, VectorB=line_sdl)  # -> Angle, Reflex
factor = ClusterInput()
multiplication = Multiplication(A=curve_side.Side, B=angle.Angle)
unit_z = UnitZ(Factor=expr("x/2", factor))
rotate = Rotate(Geometry=bounding_box.Box, Angle=multiplication, Plane=PlaneXY(0, 0, 0))  # -> Geometry, Transform
box_properties = BoxProperties(Box=rotate.Geometry)  # -> Center, Diagonal, Area, Volume, Degeneracy
vector_2pt = Vector2Pt(PointA=box_properties.Center, PointB=polygon_center.CenterV, Unitize=False)  # -> Vector, Length
move = Move(Motion=unit_z)  # -> Geometry, Transform
move_2 = Move(Geometry=rotate.Geometry, Motion=vector_2pt.Vector)  # -> Geometry, Transform
compound = Compound(Transforms=flatten([rotate.Transform, move_2.Transform, move.Transform]))
compound_2 = ClusterOutput(compound)
