# Grasshopper definition 0-1 使用UI conduit渲染.gh (Grasshopper 1.0.7)
# plug-ins: Human UI

# ----
# 0-1 使用UI conduit渲染
# 这种方式打开gh文件，所有rhino的渲染会失效，需要通过UI conduit里的 电池进行渲染。
panel = Panel("""0-1 使用UI conduit渲染
这种方式打开gh文件，所有rhino的渲染会失效，需要通过UI conduit里的 电池进行渲染。""")
swatch = ColourSwatch(SwatchColor=RGB(189, 255, 195))
tb = CreateTextBlock(Text=panel, TextSize=12, Justification=0)
merge = Merge(Data1=tb)
swatch_2 = ColourSwatch(SwatchColor=RGB(23, 23, 23))
adjustelem = AdjustElementAppearance(ElementsToAdjust=tb, Foreground=swatch_2, Background=swatch)
addelementstorui = AddElementsToRUI(Elements=flatten(merge), DoVLChecking=True)  # -> AddedElements, ElementNames
sph = Sphere(
    Base=Plane(origin=(-122.5825041, -17.54985824, 0), x=(0.02175295419, 0.9997633765, 0), y=(0.9997622245, -0.02175292912, 0.001518047832)),
    Radius=Slider(33, range=0..100))
M = Material({diffuse=RGB(221, 160, 221), emission=RGB(66, 48, 66), shine=0.5, specular=RGB(255, 255, 255), transparency=0})

toggle = BooleanToggle(True)  # disabled
launchwin = LaunchWindow(Show=toggle, Name="Control Window", Width=370, Height=400, ChildStatus=0, EnableHorizScroll=False)  # disabled
addelems = AddElements(Window=launchwin, Elements=flatten(merge), DoVLChecking=True)  # -> AddedElements, ElementNames; disabled

number_slider = Slider(3, range=0..10)
crv = Curve(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)
crv_2 = Curve(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)
point = Point([Point(-23.27963099, 39.60986527, 0), Point(15.0702989, 42.89401761, 0), Point(12.09068976, -4.434620803, 0), Point(43.29076238, 4.840897946, 0), Point(41.34422905, 24.34415729, 0)])
lng = ListLength(List=point)
series = Series(Start=0, Step=1, Count=lng)

# ---- group: 渲染polyline，可以设置颜色，线宽，pattern（见RhinoCommon），是否渲染到前景
ruidotpolylineconduit = RUIDotPolylineConduit(Polyline=crv_2, Color=ColourSwatch(SwatchColor=RGB(255, 0, 0)), Pattern=4369, Thickness=number_slider)

# ---- group: 渲染textdot，可以设置颜色，是否渲染到前景
ruidotconduit = RUIDotConduit(Point=point, Text=series, DotColor=swatch_2, TextColor=ColourSwatch(SwatchColor=RGB(255, 255, 255)), ForeDraw=True)

# ---- group: 渲染Curve，可以设置线宽，是否渲染到前景
ruicurveconduit = RUICurveConduit(Curve=crv, Color=swatch, Thickness=number_slider, ForeDraw=False)

# ---- group: 渲染Mesh
ruimeshconduit = RUIMeshConduit(Mesh=sph, Material=M)
