# Grasshopper definition 0-0 简单做一个UI.gh (Grasshopper 1.0.7)
# plug-ins: Human UI

# ----
# 0-0简单做一个UI
# 按照原来HumanUI使用方式设计好界面后，disable掉下面三个，把所有控件
# 接入AddElementsToRUI，把该文件放到Resources目录下,只能放一个。要渲染
# 东西，用UI conduit面板里的电池（后面会介绍）。
panel = Panel("""0-0简单做一个UI
按照原来HumanUI使用方式设计好界面，disable掉下面三个，把所有控件接入AddElementsToRUI，把该文件放到Resources目录下,只能放一个。要渲染东西，用UI conduit面板里的电池（后面会介绍）。""")
slider = CreateSlider(Slider=Slider(20, range=0..100), ShowBounds=False, ShowTicks=False, ShowTooltip=False, ShowValLabel=True, showLabel=True)
values = ValueListener(Elements=slider, SomeProperty=True)  # -> Values, Indices
tb = CreateTextBlock(Text=panel, TextSize=12, Justification=0)
merge = Merge(Data1=tb, Data2=slider)
M = Material({diffuse=RGB(221, 160, 221), emission=RGB(66, 48, 66), shine=0.5, specular=RGB(255, 255, 255), transparency=0})
sph = Sphere(Base=PlaneXY(0, 0, 0), Radius=values.Values)
adjustelem = AdjustElementAppearance(
    ElementsToAdjust=tb,
    Foreground=ColourSwatch(SwatchColor=RGB(23, 23, 23)),
    Background=ColourSwatch(SwatchColor=RGB(189, 255, 195)))
addelementstorui = AddElementsToRUI(Elements=flatten(merge), DoVLChecking=True)  # -> AddedElements, ElementNames
ruimeshconduit = RUIMeshConduit(Mesh=sph, Material=M)

toggle = BooleanToggle(True)  # disabled
launchwin = LaunchWindow(Show=toggle, Name="Control Window", Width=370, Height=400, ChildStatus=0, EnableHorizScroll=False)  # disabled
addelems = AddElements(Window=launchwin, Elements=flatten(merge), DoVLChecking=True)  # -> AddedElements, ElementNames; disabled
