# Grasshopper definition 0-2 让UI动起来.gh (Grasshopper 1.0.7)
# plug-ins: Human UI

# ---- group: 第一个端口获取Window
shared_window = SharedWindow()  # -> WindowObject, ViewportCtrlObject, ShadowViewportObject

# ----
# 0-2 让UI动起来
# 这种方式打开gh文件，所有expire solution会失效。刷新是通过Shared Window电池Window的expiretoken设为true进行的。
panel = Panel("""0-2 让UI动起来
这种方式打开gh文件，所有expire solution会失效。刷新是通过Shared Window电池Window的expiretoken设为true进行的，可以通过python动态设置。""")
button = CreateButton(ButtonName="重置", ButtonStyle=0)
toggle = CreateToggle(Default=False, OnLabel="播放", OffLabel="暂停")
slider = CreateSlider(Slider=Slider(0, range=0..100), ShowBounds=False, ShowTicks=False, ShowTooltip=False, ShowValLabel=True, showLabel=True)
stack = CreateStack(UIElements=[toggle, button], Horizontal=True)
tb = CreateTextBlock(Text=panel, TextSize=12, Justification=0)
merge = Merge(Data1=tb, Data2=slider, Data3=stack)
values = ValueListener(Elements=slider, SomeProperty=True)  # -> Values, Indices
addelementstorui = AddElementsToRUI(Elements=flatten(merge), DoVLChecking=True)  # -> AddedElements, ElementNames
values_2 = ValueListener(Elements=button, SomeProperty=True)  # -> Values, Indices
values_3 = ValueListener(Elements=toggle, SomeProperty=True)  # -> Values, Indices
adjustelem = AdjustElementAppearance(
    ElementsToAdjust=tb,
    Foreground=ColourSwatch(SwatchColor=RGB(23, 23, 23)),
    Background=ColourSwatch(SwatchColor=RGB(189, 255, 195)))
M = Material({diffuse=RGB(221, 160, 221), emission=RGB(66, 48, 66), shine=0.5, specular=RGB(255, 255, 255), transparency=0})

launchwin = LaunchWindow(Show=Toggle(True), Name="Control Window", Width=370, Height=400, ChildStatus=0, EnableHorizScroll=False)  # disabled
addelems = AddElements(Window=launchwin, Elements=flatten(merge), DoVLChecking=True)  # -> AddedElements, ElementNames; disabled

sph = Sphere(Base=PlaneXY(0, 0, 0), Radius=values.Values)

# ---- group: 刷新是通过Shared Window电池Window的expiretoken设为true进行的，可以通过python动态设置。
ghpython_script = GhPythonScript(toggle=values_3.Values, reset=values_2.Values, limit=Slider(100, range=0..100), wnd=shared_window.WindowObject)  # -> A; inputs toggle: Boolean, reset: Boolean
# ---------- ghpython_script: Python ----------
__author__ = "Roboticplus"
__version__ = "2021.10.25"

import rhinoscriptsyntax as rs
import scriptcontext as sc


if not sc.sticky.has_key("val"):
    sc.sticky["val"] = 0
    ghenv.Component.ExpireSolution(True)
    wnd.expireToken = True
    
else:
    step = 1
    if  reset:
        sc.sticky["val"] = 0
        A = sc.sticky["val"]
    elif sc.sticky["val"] < limit:
        if toggle:
            sc.sticky["val"] += step
            A = sc.sticky["val"]
            ghenv.Component.ExpireSolution(True)
            wnd.expireToken = True
# ---------- end ghpython_script ----------

# ---- group: 渲染Mesh
ruimeshconduit = RUIMeshConduit(Mesh=sph, Material=M)

# ----
setslider = SetSlider(UISlider=slider, Value=ghpython_script)
